# Grasshopper definition 240425Case.gh (Grasshopper 1.0.8)
# plug-ins: Eddy3D

panel = Panel("zeroGradient")
panel_2 = Panel("""specie
    {
        molWeight   12;
    }
    transport
    {
        kappa   80;
    }
    thermodynamics
    {
        Hf      1;
        Cp      1060;
    }
    equationOfState
    {
        rho     1600;
    }""")
panel_3 = Panel(""" specie
    {
        molWeight       28.9;
    }
    thermodynamics
    {
        Cp              1000;
        Hf              0;
    }
    transport
    {
        mu              1.8e-05;
        Pr              0.7;
    }""")
panel_4 = Panel("""    specie
    {
        molWeight   12;
    }
    transport
    {
        kappa   80;
    }
    thermodynamics
    {
        Hf      2.74;
        Cp      64;
    }
    equationOfState
    {
        rho     2000;
    }""")
panel_5 = Panel(""" specie
    {
        molWeight       28.9;
    }
    thermodynamics
    {
        Cp              1000;
        Hf              0;
    }
    transport
    {
        mu              1.8e-05;
        Pr              0.7;
    }""")
panel_6 = Panel("""    specie
    {
        molWeight   12;
    }
    transport
    {
        kappa   80;
    }
    thermodynamics
    {
        Hf      2.74;
        Cp      1000;
    }
    equationOfState
    {
        rho     2000;
    }""")
panel_7 = Panel(""" specie
    {
        molWeight       28.9;
    }
    thermodynamics
    {
        Cp              1000;
        Hf              0;
    }
    transport
    {
        mu              1.8e-05;
        Pr              0.7;
    }""")
panel_8 = Panel(""" specie
    {
        molWeight       28.9;
    }
    thermodynamics
    {
        Cp              1000;
        Hf              0;
    }
    transport
    {
        mu              1.8e-05;
        Pr              0.7;
    }""")
panel_9 = Panel("""    specie
    {
        molWeight   12;
    }
    transport
    {
        kappa   80;
    }
    thermodynamics
    {
        Hf      2.74;
        Cp      1100;
    }
    equationOfState
    {
        rho     2000;
    }""")
panel_10 = Panel("""    specie
    {
        molWeight   12;
    }
    transport
    {
        kappa   80;
    }
    thermodynamics
    {
        Hf      2.74;
        Cp      1450;
    }
    equationOfState
    {
        rho     2000;
    }""")
panel_11 = Panel("""    specie
    {
        molWeight   12;
    }
    transport
    {
        kappa   80;
    }
    thermodynamics
    {
        Hf      2.74;
        Cp      64;
    }
    equationOfState
    {
        rho     2000;
    }""")
insulation = Geometry(<brep referenced from the Rhino model>)
concretebottom = Geometry(<brep referenced from the Rhino model>)
intair_top = Geometry(<brep referenced from the Rhino model>)
pt = Point(<point referenced from the Rhino model>)
extairbottom = Geometry(<brep referenced from the Rhino model>)
concretetop = Geometry(<brep referenced from the Rhino model>)
# air.stl
panel_12 = Panel("air")
intair_bot = Geometry(<brep referenced from the Rhino model>)
extairtop = Geometry(<extrusion referenced from the Rhino model>)
# geom.stl
panel_13 = Panel("geom")
plaster = Geometry(<brep referenced from the Rhino model>)
pt_2 = Point(Point(0.2289702368, 0.5557985077, 0.5795751938))
slab = Geometry(<brep referenced from the Rhino model>)
pt_3 = Point(<point referenced from the Rhino model>)
pt_4 = Point(Point(0.2289702368, 0.5557985077, -0.3850733597))
pt_5 = Point(<point referenced from the Rhino model>)
brick = Geometry(<brep referenced from the Rhino model>)
pt_6 = Point(Point(1.775245124, 0.5557985077, 1.078743138))
mesh = Mesh(insulation)
pt_7 = Point(<point referenced from the Rhino model>)
pt_8 = Point(Point(0.8176895746, 0.5557985077, -0.3850733597))
pt_9 = Point(Point(1.775245124, 1.18045034, 1.078743138))
pt_10 = Point(<point referenced from the Rhino model>)
mesh_2 = Mesh(intair_top)
mesh_3 = Mesh(intair_bot)
mesh_4 = Mesh(plaster)
mesh_5 = Mesh(slab)
mesh_6 = Mesh(extairtop)
mesh_7 = Mesh(extairbottom)
mesh_8 = Mesh(concretetop)
mesh_9 = Mesh(concretebottom)
mesh_10 = Mesh(brick)
attachtouserdictionary = CSharpScript(
    geo=mesh_3,
    valName="IntairBottom",
    valType="fixedValue",
    valTemp="285.15",
    typeThermoProp="heRhoThermo",
    transportThermoProp="const",
    eqOfStateThermoProp="perfectGas",
    mixture=panel_5,
    pointInside=pt)  # -> flatten(A); inputs geo: GeometryBase, valName: String, valType: String, valTemp: String, valThermalConductivity: String, valDensity: String, valSpecificHeatCapacity: String, typeThermoProp: String, transportThermoProp: String, eqOfStateThermoProp: String, mixture: String, pointInside: Point3d
# ---------- attachtouserdictionary: C# usings ----------
using System.IO;
using System.Linq;
using System.Data;
using System.Drawing;
using System.Reflection;
using System.Windows.Forms;
using System.Xml;
using System.Xml.Linq;
using System.Runtime.InteropServices;

using Rhino.DocObjects;
using Rhino.Collections;
using GH_IO;
using GH_IO.Serialization;
# ---------- attachtouserdictionary: C# ----------
    geo.UserDictionary.Set("type", valType);
    geo.UserDictionary.Set("temp", valTemp);
    geo.UserDictionary.Set("name", valName);
    geo.UserDictionary.Set("thermalconductivity", valThermalConductivity);
    geo.UserDictionary.Set("density", valDensity);
    geo.UserDictionary.Set("heatcapacity", valSpecificHeatCapacity);

    geo.UserDictionary.Set("typeThermoProp", typeThermoProp);
    geo.UserDictionary.Set("transportThermoProp", transportThermoProp);
    geo.UserDictionary.Set("eqOfStateThermoProp", eqOfStateThermoProp);
    geo.UserDictionary.Set("mixture", mixture);
    geo.UserDictionary.Set("pointInside", pointInside);






    /*
    if(bake){
    RhinoDocument.Objects.Add(geo);
    }
    */
    A = geo;
# ---------- end attachtouserdictionary ----------
attachtouserdictionary_2 = CSharpScript(
    geo=mesh_2,
    valName="IntairTop",
    valType="fixedValue",
    valTemp="285.15",
    typeThermoProp="heRhoThermo",
    transportThermoProp="const",
    eqOfStateThermoProp="perfectGas",
    mixture=panel_7,
    pointInside=pt_6)  # -> flatten(A); inputs geo: GeometryBase, valName: String, valType: String, valTemp: String, valThermalConductivity: String, valDensity: String, valSpecificHeatCapacity: String, typeThermoProp: String, transportThermoProp: String, eqOfStateThermoProp: String, mixture: String, pointInside: Point3d; same code as attachtouserdictionary
attachtouserdictionary_3 = CSharpScript(
    geo=mesh_5,
    valName="Slab",
    valType="fixedValue",
    valTemp="285.15",
    typeThermoProp="heSolidThermo",
    transportThermoProp="constIso",
    eqOfStateThermoProp="rhoConst",
    mixture=panel_9,
    pointInside=pt_5)  # -> flatten(A); inputs geo: GeometryBase, valName: String, valType: String, valTemp: String, valThermalConductivity: String, valDensity: String, valSpecificHeatCapacity: String, typeThermoProp: String, transportThermoProp: String, eqOfStateThermoProp: String, mixture: String, pointInside: Point3d; same code as attachtouserdictionary
attachtouserdictionary_4 = CSharpScript(
    geo=mesh_7,
    valName="ExtAirBottom",
    valType="fixedValue",
    valTemp="273.15",
    typeThermoProp="heRhoThermo",
    transportThermoProp="const",
    eqOfStateThermoProp="perfectGas",
    mixture=panel_8,
    pointInside=pt_4)  # -> flatten(A); inputs geo: GeometryBase, valName: String, valType: String, valTemp: String, valThermalConductivity: String, valDensity: String, valSpecificHeatCapacity: String, typeThermoProp: String, transportThermoProp: String, eqOfStateThermoProp: String, mixture: String, pointInside: Point3d; same code as attachtouserdictionary
attachtouserdictionary_5 = CSharpScript(
    geo=mesh_6,
    valName="ExtAirTop",
    valType="fixedValue",
    valTemp="273.15",
    typeThermoProp="heRhoThermo",
    transportThermoProp="const",
    eqOfStateThermoProp="perfectGas",
    mixture=panel_3,
    pointInside=pt_2)  # -> flatten(A); inputs geo: GeometryBase, valName: String, valType: String, valTemp: String, valThermalConductivity: String, valDensity: String, valSpecificHeatCapacity: String, typeThermoProp: String, transportThermoProp: String, eqOfStateThermoProp: String, mixture: String, pointInside: Point3d; same code as attachtouserdictionary
attachtouserdictionary_6 = CSharpScript(
    geo=mesh_4,
    valName="Plaster",
    valType="fixedValue",
    valTemp="285.15",
    typeThermoProp="heSolidThermo",
    transportThermoProp="constIso",
    eqOfStateThermoProp="rhoConst",
    mixture=panel_6,
    pointInside=pt_3)  # -> flatten(A); inputs geo: GeometryBase, valName: String, valType: String, valTemp: String, valThermalConductivity: String, valDensity: String, valSpecificHeatCapacity: String, typeThermoProp: String, transportThermoProp: String, eqOfStateThermoProp: String, mixture: String, pointInside: Point3d
# ---------- attachtouserdictionary_6: C# ----------
    geo.UserDictionary.Set("type", valType);
    geo.UserDictionary.Set("temp", valTemp);
    geo.UserDictionary.Set("name", valName);
    geo.UserDictionary.Set("thermalconductivity", valThermalConductivity);
    geo.UserDictionary.Set("density", valDensity);
    geo.UserDictionary.Set("heatcapacity", valSpecificHeatCapacity);

    geo.UserDictionary.Set("typeThermoProp", typeThermoProp);
    geo.UserDictionary.Set("transportThermoProp", transportThermoProp);
    geo.UserDictionary.Set("eqOfStateThermoProp", eqOfStateThermoProp);
    geo.UserDictionary.Set("mixture", mixture);
     geo.UserDictionary.Set("pointInside", pointInside);






    /*
    if(bake){
    RhinoDocument.Objects.Add(geo);
    }
    */
    A = geo;
# ---------- end attachtouserdictionary_6 ----------
attachtouserdictionary_7 = CSharpScript(
    geo=mesh_9,
    valName="ConcreteBottom",
    valType="fixedValue",
    valTemp="293.15",
    typeThermoProp="heSolidThermo",
    transportThermoProp="constIso",
    eqOfStateThermoProp="rhoConst",
    mixture=panel_4,
    pointInside=pt_8)  # -> flatten(A); inputs geo: GeometryBase, valName: String, valType: String, valTemp: String, valThermalConductivity: String, valDensity: String, valSpecificHeatCapacity: String, typeThermoProp: String, transportThermoProp: String, eqOfStateThermoProp: String, mixture: String, pointInside: Point3d; same code as attachtouserdictionary_6
attachtouserdictionary_8 = CSharpScript(
    geo=mesh_8,
    valName="ConcreteTop",
    valType="fixedValue",
    valTemp="288.15",
    typeThermoProp="heSolidThermo",
    transportThermoProp="constIso",
    eqOfStateThermoProp="rhoConst",
    mixture=panel_11,
    pointInside=pt_7)  # -> flatten(A); inputs geo: GeometryBase, valName: String, valType: String, valTemp: String, valThermalConductivity: String, valDensity: String, valSpecificHeatCapacity: String, typeThermoProp: String, transportThermoProp: String, eqOfStateThermoProp: String, mixture: String, pointInside: Point3d; same code as attachtouserdictionary_6
attachtouserdictionary_9 = CSharpScript(
    geo=mesh,
    valName="Insulation",
    valType="fixedValue",
    valTemp="285.15",
    typeThermoProp="heSolidThermo",
    transportThermoProp="constIso",
    eqOfStateThermoProp="rhoConst",
    mixture=panel_10,
    pointInside=pt_9)  # -> flatten(A); inputs geo: GeometryBase, valName: String, valType: String, valTemp: String, valThermalConductivity: String, valDensity: String, valSpecificHeatCapacity: String, typeThermoProp: String, transportThermoProp: String, eqOfStateThermoProp: String, mixture: String, pointInside: Point3d; same code as attachtouserdictionary_6
attachtouserdictionary_10 = CSharpScript(
    geo=mesh_10,
    valName="Brick",
    valType="fixedValue",
    valTemp="273.15",
    typeThermoProp="heSolidThermo",
    transportThermoProp="constIso",
    eqOfStateThermoProp="rhoConst",
    mixture=panel_2,
    pointInside=pt_10)  # -> flatten(A); inputs geo: GeometryBase, valName: String, valType: String, valTemp: String, valThermalConductivity: String, valDensity: String, valSpecificHeatCapacity: String, typeThermoProp: String, transportThermoProp: String, eqOfStateThermoProp: String, mixture: String, pointInside: Point3d; same code as attachtouserdictionary
getname = GhPythonScript(Geo=attachtouserdictionary_7)  # -> out, Name; inputs Geo: Mesh
# ---------- getname: Python ----------
__author__ = "mimit"
__version__ = "2024.02.27"

import rhinoscriptsyntax as rs

Name = Geo.UserDictionary["name"]
# ---------- end getname ----------
getname_2 = GhPythonScript(Geo=attachtouserdictionary_3)  # -> out, Name; inputs Geo: Mesh; same code as getname
getname_3 = GhPythonScript(Geo=attachtouserdictionary)  # -> out, Name; inputs Geo: Mesh; same code as getname
getname_4 = GhPythonScript(Geo=attachtouserdictionary_8)  # -> out, Name; inputs Geo: Mesh; same code as getname
getname_5 = GhPythonScript(Geo=attachtouserdictionary_9)  # -> out, Name; inputs Geo: Mesh; same code as getname
getname_6 = GhPythonScript(Geo=attachtouserdictionary_6)  # -> out, Name; inputs Geo: Mesh; same code as getname
getname_7 = GhPythonScript(Geo=attachtouserdictionary_10)  # -> out, Name; inputs Geo: Mesh; same code as getname
getname_8 = GhPythonScript(Geo=attachtouserdictionary_5)  # -> out, Name; inputs Geo: Mesh; same code as getname
getname_9 = GhPythonScript(Geo=attachtouserdictionary_10)  # -> out, PI; inputs Geo: Mesh
# ---------- getname_9: Python ----------
__author__ = "mimit"
__version__ = "2024.02.27"

import rhinoscriptsyntax as rs

PI = Geo.UserDictionary["pointInside"]
# ---------- end getname_9 ----------
getname_10 = GhPythonScript(Geo=attachtouserdictionary_2)  # -> out, Name; inputs Geo: Mesh; same code as getname
getname_11 = GhPythonScript(Geo=attachtouserdictionary_4)  # -> out, Name; inputs Geo: Mesh; same code as getname
air_stl = Geometry([attachtouserdictionary, attachtouserdictionary_2, attachtouserdictionary_4, attachtouserdictionary_5])
geom_stl = Geometry([attachtouserdictionary_3, attachtouserdictionary_8, attachtouserdictionary_9, attachtouserdictionary_10, attachtouserdictionary_7, attachtouserdictionary_6])
allgeo = Geometry([air_stl, geom_stl])
mesh_join = MeshJoin(Meshes=air_stl)
air_stl_2 = Data(mesh_join)
mesh_11 = Mesh(air_stl_2)
attachtouserdictionary_11 = CSharpScript(geo=mesh_11, valName=panel_12, valType="zeroGradient", valTemp="285.15")  # -> flatten(A); inputs geo: GeometryBase, valName: String, valType: String, valTemp: String, valThermalConductivity: String, valDensity: String, valSpecificHeatCapacity: String
# ---------- attachtouserdictionary_11: C# ----------
    geo.UserDictionary.Set("type", valType);
    geo.UserDictionary.Set("temp", valTemp);
    geo.UserDictionary.Set("name", valName);
    geo.UserDictionary.Set("thermalconductivity", valThermalConductivity);
    geo.UserDictionary.Set("density", valDensity);
    geo.UserDictionary.Set("heatcapacity", valSpecificHeatCapacity);
    /*
    if(bake){
    RhinoDocument.Objects.Add(geo);
    }
    */
    A = geo;
# ---------- end attachtouserdictionary_11 ----------
getname_12 = GhPythonScript(Geo=attachtouserdictionary_11)  # -> out, Name; inputs Geo: Mesh; same code as getname
data = Data([brick, insulation, concretetop, concretebottom, slab, plaster, extairtop, extairbottom, intair_top, intair_bot])
mesh_join_2 = MeshJoin(Meshes=allgeo)
mesh_12 = Mesh(mesh_join_2)
attachtouserdictionary_12 = CSharpScript(geo=mesh_12, valName=panel_13, valType="zeroGradient", valTemp="285.15")  # -> flatten(A); inputs geo: GeometryBase, valName: String, valType: String, valTemp: String, valThermalConductivity: String, valDensity: String, valSpecificHeatCapacity: String; same code as attachtouserdictionary_11
getname_13 = GhPythonScript(Geo=attachtouserdictionary_12)  # -> out, Name; inputs Geo: Mesh; same code as getname
geometrybasetostring = CSharpScript(x=data)  # -> flatten(A); inputs x: list of GeometryBase
# ---------- geometrybasetostring: C# ----------
    var list = new List<String>();

    foreach (GeometryBase geo in x)
    {
      list.Add(geo.UserDictionary["name"].ToString());
      list.Add(geo.UserDictionary["name"].ToString().Split(new string[] { "_to_" }, StringSplitOptions.None)[1] + "_to_" + geo.UserDictionary["name"].ToString().Split(new string[] { "_to_" }, StringSplitOptions.None)[0]);
    }



    A = list;
# ---------- end geometrybasetostring ----------
cluster = Cluster(C=mesh_join_2)
bang = ExplodeTree(Data=simplify(cluster))  # -> Branch0, Branch1, Branch2, Branch3, Branch4, Branch5
maxy = Geometry(bang.Branch2)
minz = Geometry(bang.Branch4)
maxx = Geometry(bang.Branch1)
miny = Geometry(bang.Branch0)
maxz = Geometry(bang.Branch5)
# BlockMesh Boundary patches
minx = Geometry(bang.Branch3)
mesh_13 = Mesh(maxz)
mesh_14 = Mesh(maxy)
mesh_15 = Mesh(minx)
mesh_16 = Mesh(minz)
mesh_17 = Mesh(maxx)
mesh_18 = Mesh(miny)
attachtouserdictionary_13 = CSharpScript(geo=mesh_14, valName="maxY", valType="fixedValue", valTemp="273")  # -> flatten(A); inputs geo: GeometryBase, valName: String, valType: String, valTemp: String, valThermalConductivity: String, valDensity: String, valSpecificHeatCapacity: String; same code as attachtouserdictionary_11
attachtouserdictionary_14 = CSharpScript(geo=mesh_15, valName="minX", valType="fixedValue", valTemp="273")  # -> flatten(A); inputs geo: GeometryBase, valName: String, valType: String, valTemp: String, valThermalConductivity: String, valDensity: String, valSpecificHeatCapacity: String; same code as attachtouserdictionary_11
attachtouserdictionary_15 = CSharpScript(geo=mesh_16, valName="minZ", valType="fixedValue", valTemp="293")  # -> flatten(A); inputs geo: GeometryBase, valName: String, valType: String, valTemp: String, valThermalConductivity: String, valDensity: String, valSpecificHeatCapacity: String; same code as attachtouserdictionary_11
attachtouserdictionary_16 = CSharpScript(geo=mesh_13, valName="maxZ", valType="fixedValue", valTemp="273")  # -> flatten(A); inputs geo: GeometryBase, valName: String, valType: String, valTemp: String, valThermalConductivity: String, valDensity: String, valSpecificHeatCapacity: String; same code as attachtouserdictionary_11
attachtouserdictionary_17 = CSharpScript(geo=mesh_17, valName="maxX", valType="fixedValue", valTemp="293")  # -> flatten(A); inputs geo: GeometryBase, valName: String, valType: String, valTemp: String, valThermalConductivity: String, valDensity: String, valSpecificHeatCapacity: String; same code as attachtouserdictionary_11
attachtouserdictionary_18 = CSharpScript(geo=mesh_18, valName="minY", valType="fixedValue", valTemp="283")  # -> flatten(A); inputs geo: GeometryBase, valName: String, valType: String, valTemp: String, valThermalConductivity: String, valDensity: String, valSpecificHeatCapacity: String; same code as attachtouserdictionary_11
getname_14 = GhPythonScript(Geo=attachtouserdictionary_13)  # -> out, Name; inputs Geo: Mesh; same code as getname
getname_15 = GhPythonScript(Geo=attachtouserdictionary_14)  # -> out, Name; inputs Geo: Mesh; same code as getname
getname_16 = GhPythonScript(Geo=attachtouserdictionary_15)  # -> out, Name; inputs Geo: Mesh; same code as getname
getname_17 = GhPythonScript(Geo=attachtouserdictionary_17)  # -> out, Name; inputs Geo: Mesh; same code as getname
getname_18 = GhPythonScript(Geo=attachtouserdictionary_18)  # -> out, Name; inputs Geo: Mesh; same code as getname
getname_19 = GhPythonScript(Geo=attachtouserdictionary_16)  # -> out, Name; inputs Geo: Mesh; same code as getname
getpointsinsidegeometry = GhPythonScript(
    brep_input=[attachtouserdictionary_9, attachtouserdictionary_10, attachtouserdictionary_8, attachtouserdictionary_7, attachtouserdictionary_3, attachtouserdictionary_5, attachtouserdictionary_4, attachtouserdictionary_2, attachtouserdictionary, attachtouserdictionary_6],
    scaleFactor=Slider(1, range=0.7..1.2),
    tol=Slider(0.7, range=0.7..1.2))  # -> flatten(out), flatten(point_output); inputs brep_input: Mesh; disabled
# ---------- getpointsinsidegeometry: Python ----------
__author__ = "mimit"
__version__ = "2024.02.27"

import rhinoscriptsyntax as rs
import random

import Rhino.Geometry as rg
import random

def scale_brep(brep, scale_factor):
    """
    Scales a Brep object by a given factor about its centroid.
    """
    # Calculate the area centroid of the Brep
    area_mass_properties = rg.AreaMassProperties.Compute(brep)
    if not area_mass_properties:
        return None
    
    centroid = area_mass_properties.Centroid
    scale = rg.Transform.Scale(centroid, scale_factor)
    
    # Create a copy of the Brep and scale it
    scaled_brep = brep
    scaled_brep.Transform(scale)
    
    return scaled_brep

def point_in_brep(point, brep):
    """
    Checks if the point is inside the Brep.
    """
    tolerance = tol  # Tolerance for the inside check
    return brep.IsPointInside(point, tolerance,  True)

# Example usage

# Define the scale factor for the buffer zone
scale_factor = scaleFactor  # Adjust this to control the buffer size

# Assuming `brep_input` is provided as an input to this script component
scaled_brep = scale_brep(brep_input, scale_factor)

if not scaled_brep:
    print("Failed to scale the Brep.")
else:
    # Set random seed for reproducibility
    random.seed(40)
    
    # Assuming the Brep has a valid bounding box, get it
    bbox = scaled_brep.GetBoundingBox(True)
    
    points_inside = 0
    total_points = 0
    p = []
    
    # Generate points until a point is found within the scaled Brep
    while points_inside == 0 and total_points < 1000:  # Limit to 1000 attempts
        x = random.uniform(bbox.Min.X, bbox.Max.X)
        y = random.uniform(bbox.Min.Y, bbox.Max.Y)
        z = random.uniform(bbox.Min.Z, bbox.Max.Z)
        
        point = rg.Point3d(x, y, z)
        
        if point_in_brep(point, scaled_brep):
            points_inside += 1
            p.append(point)
        
        total_points += 1
    
    # Output the points found inside the Brep
    point_output = p
    if points_inside > 0:
        a = "Found point inside scaled Brep."
    else:
        a = "No point found inside scaled Brep within 1000 attempts."
# ---------- end getpointsinsidegeometry ----------

# ---- group: ExportSTL
currentfolder = CSharpScript()  # -> PATH
# ---------- currentfolder: C# usings ----------
using System.IO;
# ---------- currentfolder: C# ----------
    GH_Document gh_d = owner.OnPingDocument();

    if (gh_d.IsFilePathDefined)
    {
      Print("A path is defined.");

      PATH = System.IO.Path.GetDirectoryName(gh_d.FilePath);
      //B = Rhino.RhinoDoc.ActiveDoc.Path;

    }
    else
    {
      Print("No path defined.");
    }
# ---------- end currentfolder ----------
concat = Concatenate(FragmentA=currentfolder, FragmentB="\Case")
concat_2 = Concatenate(FragmentA=concat, FragmentB="\constant\triSurface\geom.stl")
concat_3 = Concatenate(FragmentA=concat, FragmentB="\constant\triSurface\air.stl")
stl_exporter = STLExporter(
    Geometry=[attachtouserdictionary_10, attachtouserdictionary_9, attachtouserdictionary_8, attachtouserdictionary_3, attachtouserdictionary_5, attachtouserdictionary_7, attachtouserdictionary_6],
    File=concat_2,
    Mode=0,
    EdgeLength=0)
stl_exporter_2 = STLExporter(
    Geometry=[attachtouserdictionary_5, attachtouserdictionary_2, attachtouserdictionary, attachtouserdictionary_4, attachtouserdictionary_6],
    File=concat_3,
    Mode=0,
    EdgeLength=0)

# ----
blockmesh = BlockMesh(content=flatten(cluster))  # -> series_2, panel_2, result
entwine = Entwine(
    Branch00=attachtouserdictionary_10,
    Branch01=attachtouserdictionary_9,
    Branch02=attachtouserdictionary_8,
    Branch03=attachtouserdictionary_7,
    Branch04=attachtouserdictionary_3,
    Branch05=attachtouserdictionary_6,
    Branch06=attachtouserdictionary_5,
    Branch07=attachtouserdictionary_4,
    Branch08=attachtouserdictionary_2,
    Branch09=attachtouserdictionary,
    FlattenInputs=True)  # -> flatten(Result)
getname_20 = GhPythonScript(Geo=entwine)  # -> out, PI; inputs Geo: Mesh; same code as getname_9
makeofdict = MakeOFDict(text=getname_20.PI)
panel_14 = Panel(blockmesh.result)
panel_15 = Panel(makeofdict)
getname_21 = GhPythonScript(Geo=entwine)  # -> out, Name; inputs Geo: Mesh; same code as getname
panel_16 = Panel(concat)
text_tag_3d = TextTag3D(Location=blockmesh.panel_2, Text=blockmesh.series_2, Size=1, Justification=7)
# Surf Combinations
cross_reference = CrossReference(ListListA=entwine, ListListB=entwine, CrossMode=1)  # -> ListListA, ListListB
getname_22 = GhPythonScript(Geo=cross_reference.ListListB)  # -> out, Name; inputs Geo: Mesh; same code as getname
getname_23 = GhPythonScript(Geo=cross_reference.ListListA)  # -> out, Name; inputs Geo: Mesh; same code as getname
join = TextJoin(Text=panel_14)
data_2 = Data([cross_reference.ListListA, cross_reference.ListListB])
getname_24 = GhPythonScript(Geo=data_2)  # -> out, Name; inputs Geo: Mesh; same code as getname
concatenate = Concatenate(B="(", Fragment_A=panel_15, A=" ", Fragment_B=getname_21.Name, C=")")
panel_17 = Panel(concatenate)
join_2 = TextJoin(Text=panel_17)
panel_18 = Panel("""/*--------------------------------*- C++ -*----------------------------------*\
| =========                 |                                                 |
| \\      /  F ield         | OpenFOAM: The Open Source CFD Toolbox           |
|  \\    /   O peration     | Version:  2306                                  |
|   \\  /    A nd           | Website:  www.openfoam.com                      |
|    \\/     M anipulation  |                                                 |
\*---------------------------------------------------------------------------*/
FoamFile
{
    version     2.0;
    format      ascii;
    arch        "LSB;label=32;scalar=64";
    class       volScalarField;
    location    "0/";
    object      T;
}
// * * * * * * * * * * * * * * * * * * * * * * * * * * * * * * * * * * * * * //

dimensions      [ 0 0 0 1 0 0 0 ];

internalField   uniform 288;""")
panel_19 = Panel("""/*--------------------------------*- C++ -*----------------------------------*\
| =========                 |                                                 |
| \\      /  F ield         | OpenFOAM: The Open Source CFD Toolbox           |
|  \\    /   O peration     | Version:  v2306                                 |
|   \\  /    A nd           | Website:  www.openfoam.com                      |
|    \\/     M anipulation  |                                                 |
\*---------------------------------------------------------------------------*/
FoamFile
{
    version     2.0;
    format      ascii;
    class       dictionary;
    object      fvSolution;
}
// * * * * * * * * * * * * * * * * * * * * * * * * * * * * * * * * * * * * * //

solvers
{
    "(rho|rhoFinal)"
    {
        solver          PCG;
        preconditioner  DIC;
        tolerance       1e-7;
        relTol          0;
    }

    p_rgh
    {
        solver           GAMG;
        tolerance        1e-7;
        relTol           0.01;
        smoother         GaussSeidel;
    }

    p_rghFinal
    {
        $p_rgh;
        tolerance        1e-7;
        relTol           0;
    }

    "(U|h|k|epsilon|R)"
    {
        solver           PBiCGStab;
        preconditioner   diagonal;
        tolerance        1e-7;
        relTol           0.1;
    }

    "(U|h|k|epsilon|R)Final"
    {
        $U;
        tolerance        1e-07;
        relTol           0;
    }
}

PIMPLE
{
    momentumPredictor   yes;
    nCorrectors         2;
    nNonOrthogonalCorrectors 0;
    pRefCell    0;
    pRefValue   1e5;
}

relaxationFactors
{
    equations
    {
        "h.*"           1;
        "U.*"           1;
    }
}


// ************************************************************************* //""")
geometry = Geometry(<curve referenced from the Rhino model>)
geometry_2 = Geometry(<curve referenced from the Rhino model>)
geometry_3 = Geometry(<curve referenced from the Rhino model>)
divide_distance = DivideDistance(Curve=geometry, Distance="0.01")  # -> Points, Tangents, Parameters
divide_distance_2 = DivideDistance(Curve=geometry_3, Distance="0.01")  # -> Points, Tangents, Parameters
divide_distance_3 = DivideDistance(Curve=geometry_2, Distance="0.01")  # -> Points, Tangents, Parameters
panel_20 = Panel("""/*--------------------------------*- C++ -*----------------------------------*\
| =========                 |                                                 |
| \\      /  F ield         | OpenFOAM: The Open Source CFD Toolbox           |
|  \\    /   O peration     | Version:  2306                                  |
|   \\  /    A nd           | Website:  www.openfoam.com                      |
|    \\/     M anipulation  |                                                 |
\*---------------------------------------------------------------------------*/
FoamFile
{
    version     2.0;
    format      ascii;
    arch        "LSB;label=32;scalar=64";
    class       volScalarField;
    location    "0/";
    object      p_rgh;
}""")
panel_21 = Panel("""/*--------------------------------*- C++ -*----------------------------------*\
| =========                 |                                                 |
| \\      /  F ield         | OpenFOAM: The Open Source CFD Toolbox           |
|  \\    /   O peration     | Version:  2306                                  |
|   \\  /    A nd           | Website:  www.openfoam.com                      |
|    \\/     M anipulation  |                                                 |
\*---------------------------------------------------------------------------*/
FoamFile
{
    version     2.0;
    format      ascii;
    arch        "LSB;label=32;scalar=64";
    class       volVectorField;
    location    "0/";
    object      U;
}""")
panel_22 = Panel("""/*--------------------------------*- C++ -*----------------------------------*\
| =========                 |                                                 |
| \\      /  F ield         | OpenFOAM: The Open Source CFD Toolbox           |
|  \\    /   O peration     | Version:  2306                                  |
|   \\  /    A nd           | Website:  www.openfoam.com                      |
|    \\/     M anipulation  |                                                 |
\*---------------------------------------------------------------------------*/
FoamFile
{
    version     2.0;
    format      ascii;
    arch        "LSB;label=32;scalar=64";
    class       volScalarField;
    location    "0/";
    object      p;
}""")
# /*--------------------------------*- C++ -*----------------------------------*\
# | =========                 |                                                 |
# | \\      /  F ield         | OpenFOAM: The Open Source CFD Toolbox           |
# |  \\    /   O peration     | Version:  v2306                                 |
# |   \\  /    A nd           | Website:  www.openfoam.com                      |
# |    \\/     M anipulation  |                                                 |
# \*---------------------------------------------------------------------------*/
# FoamFile
# {
#     version     2.0;
#     format      ascii;
#     class       dictionary;
#     object      fvSolution;
# }
# // * * * * * * * * * * * * * * * * * * * * * * * * * * * * * * * * * * * * * //
# 
# solvers
# {
#     h
#     {
#         solver           PCG;
#         preconditioner   DIC;
#         tolerance        1e-06;
#         relTol           0.1;
#     }
# 
#     hFinal
#     {
#         $h;
#         tolerance        1e-06;
#         relTol           0;
#     }
# }
# 
# PIMPLE
# {
#     nNonOrthogonalCorrectors 0;
# }
# 
# 
# // ************************************************************************* //
panel_23 = Panel("fvSolution")
# Write out  system/{zone}\fvSchemes Fluid
panel_24 = Panel("fvSchemes")
# Write out  constant\{zone}\turbulenceProperties
panel_25 = Panel("turbulenceProperties")
makeofdict_2 = MakeOFDict(text=divide_distance_2.Points)
panel_26 = Panel("fvSchemes")
panel_27 = Panel("""/*--------------------------------*- C++ -*----------------------------------*\
| =========                 |                                                 |
| \\      /  F ield         | OpenFOAM: The Open Source CFD Toolbox           |
|  \\    /   O peration     | Version:  v2306                                 |
|   \\  /    A nd           | Website:  www.openfoam.com                      |
|    \\/     M anipulation  |                                                 |
\*---------------------------------------------------------------------------*/
FoamFile
{
    version     2.0;
    format      ascii;
    class       dictionary;
    object      fvSchemes;
}
// * * * * * * * * * * * * * * * * * * * * * * * * * * * * * * * * * * * * * //

ddtSchemes
{
    default         Euler;
}

gradSchemes
{
    default         Gauss linear;
}

divSchemes
{
    default         none;

    div(phi,U)      Gauss upwind;

    energy          Gauss upwind;
    div(phi,K)      Gauss linear;
    div(phi,h)      $energy;

    turbulence      Gauss upwind;
    div(phi,k)      $turbulence;
    div(phi,epsilon) $turbulence;
    div(phi,R)      $turbulence;
    div(R)          Gauss linear;

    div(((rho*nuEff)*dev2(T(grad(U))))) Gauss linear;
}

laplacianSchemes
{
    default         Gauss linear corrected;
}

interpolationSchemes
{
    default         linear;
}

snGradSchemes
{
    default         corrected;
}


// ************************************************************************* //""")
# Write out  system/{zone}\fvSchemes Solid
panel_28 = Panel("""/*--------------------------------*- C++ -*----------------------------------*\
| =========                 |                                                 |
| \\      /  F ield         | OpenFOAM: The Open Source CFD Toolbox           |
|  \\    /   O peration     | Version:  v2306                                 |
|   \\  /    A nd           | Website:  www.openfoam.com                      |
|    \\/     M anipulation  |                                                 |
\*---------------------------------------------------------------------------*/
FoamFile
{
    version     2.0;
    format      ascii;
    class       dictionary;
    object      fvSchemes;
}
// * * * * * * * * * * * * * * * * * * * * * * * * * * * * * * * * * * * * * //

ddtSchemes
{
    default         Euler;
}

gradSchemes
{
    default         Gauss linear;
}

divSchemes
{
    default         none;

    div(phi,U)      Gauss upwind;

    energy          Gauss upwind;
    div(phi,K)      Gauss linear;
    div(phi,h)      $energy;

    turbulence      Gauss upwind;
    div(phi,k)      $turbulence;
    div(phi,epsilon) $turbulence;
    div(phi,R)      $turbulence;
    div(R)          Gauss linear;

    div(((rho*nuEff)*dev2(T(grad(U))))) Gauss linear;
}

laplacianSchemes
{
    default         Gauss linear corrected;
}

interpolationSchemes
{
    default         linear;
}

snGradSchemes
{
    default         corrected;
}


// ************************************************************************* //""")
panel_29 = Panel("""/*--------------------------------*- C++ -*----------------------------------*\
| =========                 |                                                 |
| \\      /  F ield         | OpenFOAM: The Open Source CFD Toolbox           |
|  \\    /   O peration     | Version:  v2306                                 |
|   \\  /    A nd           | Website:  www.openfoam.com                      |
|    \\/     M anipulation  |                                                 |
\*---------------------------------------------------------------------------*/
FoamFile
{
    version     2.0;
    format      ascii;
    class       dictionary;
    object      turbulenceProperties;
}
// * * * * * * * * * * * * * * * * * * * * * * * * * * * * * * * * * * * * * //

simulationType  laminar;


// ************************************************************************* //""")
text_join = TextJoin(Text=makeofdict_2)
makeofdict_3 = MakeOFDict(text=divide_distance.Points)
makeofdict_4 = MakeOFDict(text=divide_distance_3.Points)
# Write out 0/zone_*/p_rgh
# Write out 0/p_rgh
boundarypatches = Geometry([attachtouserdictionary_14, attachtouserdictionary_17, attachtouserdictionary_18, attachtouserdictionary_13, attachtouserdictionary_15, attachtouserdictionary_16])
# Write out  0/zone_*/T
panel_30 = Panel("T")
text_join_2 = TextJoin(Text=makeofdict_3)
# Write out 0/zone_*/U
# Write out 0/U
boundarypatches_2 = Geometry([attachtouserdictionary_14, attachtouserdictionary_17, attachtouserdictionary_18, attachtouserdictionary_13, attachtouserdictionary_15, attachtouserdictionary_16])
text_join_3 = TextJoin(Text=makeofdict_4)
panel_31 = Panel("""/*--------------------------------*- C++ -*----------------------------------*\
| =========                 |                                                 |
| \\      /  F ield         | OpenFOAM: The Open Source CFD Toolbox           |
|  \\    /   O peration     | Version:  4.1                                   |
|   \\  /    A nd           | Web:      www.OpenFOAM.org                      |
|    \\/     M anipulation  |                                                 |
\*---------------------------------------------------------------------------*/
FoamFile
{
    version     2.0;
    format      binary;
    class       volScalarField;
    location    "0/";
    object      T;
}
// * * * * * * * * * * * * * * * * * * * * * * * * * * * * * * * * * * * * * //

dimensions      [ 0 0 0 1 0 0 0 ];

internalField   uniform 274;""")  # disabled
# Write out 0/zone_*/p
# Write out 0/p
boundarypatches_3 = Geometry([attachtouserdictionary_14, attachtouserdictionary_17, attachtouserdictionary_18, attachtouserdictionary_13, attachtouserdictionary_15, attachtouserdictionary_16])
panel_32 = Panel("""/*--------------------------------*- C++ -*----------------------------------*\
| =========                 |                                                 |
| \\      /  F ield         | OpenFOAM: The Open Source CFD Toolbox           |
|  \\    /   O peration     | Version:  v2306                                 |
|   \\  /    A nd           | Website:  www.openfoam.com                      |
|    \\/     M anipulation  |                                                 |
\*---------------------------------------------------------------------------*/
FoamFile
{
    version     2.0;
    format      ascii;
    class       dictionary;
    object      meshQualityDict;
}
// * * * * * * * * * * * * * * * * * * * * * * * * * * * * * * * * * * * * * //

// Include defaults parameters from master dictionary
#includeEtc "caseDicts/meshQualityDict"


// ************************************************************************* //""")
# Write out  system\meshQualityDict
panel_33 = Panel("meshQualityDict")
panel_34 = Panel("""/*--------------------------------*- C++ -*----------------------------------*\
| =========                 |                                                 |
| \\      /  F ield         | OpenFOAM: The Open Source CFD Toolbox           |
|  \\    /   O peration     | Version:  v2306                                 |
|   \\  /    A nd           | Website:  www.openfoam.com                      |
|    \\/     M anipulation  |                                                 |
\*---------------------------------------------------------------------------*/
FoamFile
{
    version     2.0;
    format      ascii;
    class       uniformDimensionedVectorField;
    object      g;
}
// * * * * * * * * * * * * * * * * * * * * * * * * * * * * * * * * * * * * * //

dimensions      [0 1 -2 0 0 0 0];
value           (0 -9.81 0);


// ************************************************************************* //""")
panel_35 = Panel("""/*--------------------------------*- C++ -*----------------------------------*\
| =========                 |                                                 |
| \\      /  F ield         | OpenFOAM: The Open Source CFD Toolbox           |
|  \\    /   O peration     | Version:  v2306                                 |
|   \\  /    A nd           | Website:  www.openfoam.com                      |
|    \\/     M anipulation  |                                                 |
\*---------------------------------------------------------------------------*/
FoamFile
{
    version     2.0;
    format      ascii;
    class       dictionary;
    object      surfaceFeatureExtractDict;
}
// * * * * * * * * * * * * * * * * * * * * * * * * * * * * * * * * * * * * * //

geom.stl
{
    extractionMethod    extractFromSurface;

    // Mark edges whose adjacent surface normals are at an angle less
    // than includedAngle as features
    // - 0  : selects no edges
    // - 180: selects all edges
    includedAngle       150;

    // Write options
    writeFeatureEdgeMesh    yes;

    // Write features to obj format for postprocessing
    writeObj                yes;
}
air.stl
{
    extractionMethod    extractFromSurface;

    // Mark edges whose adjacent surface normals are at an angle less
    // than includedAngle as features
    // - 0  : selects no edges
    // - 180: selects all edges
    includedAngle       150;

    // Write options
    writeFeatureEdgeMesh    yes;

    // Write features to obj format for postprocessing
    writeObj                yes;
}


// ************************************************************************* //""")
panel_36 = Panel("""/*--------------------------------*- C++ -*----------------------------------*\
| =========                 |                                                 |
| \\      /  F ield         | OpenFOAM: The Open Source CFD Toolbox           |
|  \\    /   O peration     | Version:  v2306                                 |
|   \\  /    A nd           | Website:  www.openfoam.com                      |
|    \\/     M anipulation  |                                                 |
\*---------------------------------------------------------------------------*/
FoamFile
{
    version     2.0;
    format      ascii;
    class       dictionary;
    object      controlDict;
}
// * * * * * * * * * * * * * * * * * * * * * * * * * * * * * * * * * * * * * //

application     chtMultiRegionFoam;

startFrom       latestTime;

startTime       0;

stopAt          endTime;

endTime         10000;

deltaT          2;

writeControl    adjustable;

writeInterval   10;

purgeWrite      10;

writeFormat     binary;

writePrecision  6;

writeCompression off;

timeFormat      general;

timePrecision   6;

runTimeModifiable true;

maxCo           0.3;

maxDi           10.0;

adjustTimeStep  yes;


// ************************************************************************* //""")
panel_37 = Panel("""/*--------------------------------*- C++ -*----------------------------------*\
| =========                 |                                                 |
| \\      /  F ield         | OpenFOAM: The Open Source CFD Toolbox           |
|  \\    /   O peration     | Version:  v2306                                 |
|   \\  /    A nd           | Website:  www.openfoam.com                      |
|    \\/     M anipulation  |                                                 |
\*---------------------------------------------------------------------------*/
FoamFile
{{
    version     2.0;
    format      ascii;
    class       dictionary;
    object      snappyHexMeshDict;
}}
// * * * * * * * * * * * * * * * * * * * * * * * * * * * * * * * * * * * * * //

// Which of the steps to run
castellatedMesh true;
snap            true;
addLayers       false;


// Geometry. Definition of all surfaces. All surfaces are of class
// searchableSurface.
// Surfaces are used
// - to specify refinement for any mesh cell intersecting it
// - to specify refinement for any mesh cell inside/outside/near
// - to 'snap' the mesh boundary to the surface
geometry
{{
    geom.stl
    {{
        type triSurfaceMesh;
        name geom;
    }}

    air.stl
    {{
        type triSurfaceMesh;
        name air;
    }}
}}


// Settings for the castellatedMesh generation.
castellatedMeshControls
{{

    // Refinement parameters
    // ~~~~~~~~~~~~~~~~~~~~~

    // If local number of cells is >= maxLocalCells on any processor
    // switches from from refinement followed by balancing
    // (current method) to (weighted) balancing before refinement.
    maxLocalCells 100000;

    // Overall cell limit (approximately). Refinement will stop immediately
    // upon reaching this number so a refinement level might not complete.
    // Note that this is the number of cells before removing the part which
    // is not 'visible' from the keepPoint. The final number of cells might
    // actually be a lot less.
    maxGlobalCells 2000000;

    // The surface refinement loop might spend lots of iterations
    // refining just a few cells. This setting will cause refinement
    // to stop if <= minimumRefine are selected for refinement. Note:
    // it will at least do one iteration (unless the number of cells
    // to refine is 0)
    minRefinementCells 10;

    // Number of buffer layers between different levels.
    // 1 means normal 2:1 refinement restriction, larger means slower
    // refinement.
    nCellsBetweenLevels 2;



    // Explicit feature edge refinement
    // ~~~~~~~~~~~~~~~~~~~~~~~~~~~~~~~~

    // Specifies a level for any cell intersected by its edges.
    // This is a featureEdgeMesh, read from constant/triSurface for now.
    features
    (
        {{
            file "geom.extendedFeatureEdgeMesh";    //"geom.eMesh";
            level 2;
        }}
        {{
            file "air.extendedFeatureEdgeMesh";    //"air.eMesh";
            level 2;
        }}
    );



    // Surface based refinement
    // ~~~~~~~~~~~~~~~~~~~~~~~~

    // Specifies two levels for every surface. The first is the minimum level,
    // every cell intersecting a surface gets refined up to the minimum level.
    // The second level is the maximum level. Cells that 'see' multiple
    // intersections where the intersections make an
    // angle > resolveFeatureAngle get refined up to the maximum level.

    refinementSurfaces
    {{
        geom
        {{
            // Surface-wise min and max refinement level
            level (2 2);
        }}
        air
        {{
            // Surface-wise min and max refinement level
            level (2 2);
        }}
    }}

    // Resolve sharp angles
    resolveFeatureAngle 30;


    // Region-wise refinement
    // ~~~~~~~~~~~~~~~~~~~~~~

    // Specifies refinement level for cells in relation to a surface. One of
    // three modes
    // - distance. 'levels' specifies per distance to the surface the
    //   wanted refinement level. The distances need to be specified in
    //   descending order.
    // - inside. 'levels' is only one entry and only the level is used. All
    //   cells inside the surface get refined up to the level. The surface
    //   needs to be closed for this to be possible.
    // - outside. Same but cells outside.

    refinementRegions
    {{
        //refinementBox
        //{{
        //    mode inside;
        //    levels ((1E15 4));
        //}}
    }}


    // Mesh selection
    // ~~~~~~~~~~~~~~

    // After refinement patches get added for all refinementSurfaces and
    // all cells intersecting the surfaces get put into these patches. The
    // section reachable from the locationInMesh is kept.
    // NOTE: This point should never be on a face, always inside a cell, even
    // after refinement.
  

locationsInMesh
(


{0}







);







    // Whether any faceZones (as specified in the refinementSurfaces)
    // are only on the boundary of corresponding cellZones or also allow
    // free-standing zone faces. Not used if there are no faceZones.
    allowFreeStandingZoneFaces false;
}}



// Settings for the snapping.
snapControls
{{
    //- Number of patch smoothing iterations before finding correspondence
    //  to surface
    nSmoothPatch 3;

    //- Relative distance for points to be attracted by surface feature point
    //  or edge. True distance is this factor times local
    //  maximum edge length.
    tolerance 1.0;

    //- Number of mesh displacement relaxation iterations.
    nSolveIter 30;

    //- Maximum number of snapping relaxation iterations. Should stop
    //  before upon reaching a correct mesh.
    nRelaxIter 5;

    //- Highly experimental and wip: number of feature edge snapping
    //  iterations. Leave out altogether to disable.
    //  Of limited use in this case since faceZone faces not handled.
    nFeatureSnapIter 10;
}}



// Settings for the layer addition.
addLayersControls
{{
    relativeSizes true;

    // Per final patch (so not geometry!) the layer information
    layers
    {{
        maxY
        {{
            nSurfaceLayers 3;
        }}
    }}

    // Expansion factor for layer mesh
    expansionRatio 1.3;

    // Wanted thickness of final added cell layer. If multiple layers
    // is the thickness of the layer furthest away from the wall.
    // Relative to undistorted size of cell outside layer.
    // See relativeSizes parameter.
    finalLayerThickness 1;

    // Minimum thickness of cell layer. If for any reason layer
    // cannot be above minThickness do not add layer.
    // Relative to undistorted size of cell outside layer.
    minThickness 0.1;

    // If points get not extruded do nGrow layers of connected faces that are
    // also not grown. This helps convergence of the layer addition process
    // close to features.
    // Note: changed(corrected) w.r.t 1.7.x! (didn't do anything in 1.7.x)
    nGrow 0;

    // Advanced settings

    // When not to extrude surface. 0 is flat surface, 90 is when two faces
    // are perpendicular
    featureAngle 30;

    // Maximum number of snapping relaxation iterations. Should stop
    // before upon reaching a correct mesh.
    nRelaxIter 3;

    // Number of smoothing iterations of surface normals
    nSmoothSurfaceNormals 1;

    // Number of smoothing iterations of interior mesh movement direction
    nSmoothNormals 3;

    // Smooth layer thickness over surface patches
    nSmoothThickness 2;

    // Stop layer growth on highly warped cells
    maxFaceThicknessRatio 0.5;

    // Reduce layer growth where ratio thickness to medial
    // distance is large
    maxThicknessToMedialRatio 1;

    // Angle used to pick up medial axis points
    // Note: changed(corrected) w.r.t 1.7.x! 90 degrees corresponds to 130
    // in 1.7.x.
    minMedialAxisAngle 90;

    // Create buffer region for new layer terminations
    nBufferCellsNoExtrude 0;

    // Overall max number of layer addition iterations. The mesher will exit
    // if it reaches this number of iterations; possibly with an illegal
    // mesh.
    nLayerIter 50;
}}



// Generic mesh quality settings. At any undoable phase these determine
// where to undo.
meshQualityControls
{{
    #include "meshQualityDict"

    // Advanced

    //- Number of error distribution iterations
    nSmoothScale 4;
    //- Amount to scale back displacement at error points
    errorReduction 0.75;
}}


// Advanced

// Merge tolerance. Is fraction of overall bounding box of initial mesh.
// Note: the write tolerance needs to be higher than this.
mergeTolerance 1e-6;


// ************************************************************************* //""")
# Write out  system\probingLine1
panel_38 = Panel("probingLine1")
# Write out  system\surfaceFeatureExtractDict
panel_39 = Panel("surfaceFeatureExtractDict")
panel_40 = Panel("""/*--------------------------------*- C++ -*----------------------------------*\
| =========                 |                                                 |
| \\      /  F ield         | OpenFOAM: The Open Source CFD Toolbox           |
|  \\    /   O peration     | Version:  v2306                                 |
|   \\  /    A nd           | Website:  www.openfoam.com                      |
|    \\/     M anipulation  |                                                 |
\*---------------------------------------------------------------------------*/
FoamFile
{
    version     2.0;
    format      ascii;
    class       dictionary;
    object      regionProperties;
}
// * * * * * * * * * * * * * * * * * * * * * * * * * * * * * * * * * * * * * //

regions
(
    fluid       (ExtAirTop ExtAirBottom IntairTop IntairBottom)
    solid       (Brick Insulation ConcreteTop ConcreteBottom Slab Plaster)
);



// ************************************************************************* //""")
# Write out  system\snappyHexMeshDict
panel_41 = Panel("snappyHexMeshDict")
# Write out  system\probingLine2
panel_42 = Panel("probingLine2")
panel_43 = Panel("""/*--------------------------------*- C++ -*----------------------------------*\
| =========                 |                                                 |
| \\      /  F ield         | OpenFOAM: The Open Source CFD Toolbox           |
|  \\    /   O peration     | Version:  v2306                                 |
|   \\  /    A nd           | Website:  www.openfoam.com                      |
|    \\/     M anipulation  |                                                 |
\*---------------------------------------------------------------------------*/
FoamFile
{
    version     2.0;
    format      ascii;
    class       dictionary;
    object      radiationProperties;
}
// * * * * * * * * * * * * * * * * * * * * * * * * * * * * * * * * * * * * * //

radiation       off;

radiationModel  none;


// ************************************************************************* //""")
panel_44 = Panel("""/*--------------------------------*- C++ -*----------------------------------*\
  | =========                 |                                                 |
  | \\      /  F ield         | OpenFOAM: The Open Source CFD Toolbox           |
  |  \\    /   O peration     | Version:  5                                     |
  |   \\  /    A nd           | Web:      www.OpenFOAM.org                      |
  |    \\/     M anipulation  |                                                 |
  \*---------------------------------------------------------------------------*/

probingLine1
{{
                type probes;
                libs ("libsampling.so");
                writeControl writeTime;

                interpolationScheme cellPointFace;
                //interpolationScheme cellPoint;

                setFormat csv;

                fields (T);

                

                probeLocations
                  (



{0}


);
}}

            // ************************************************************************* //""")
c_script = CSharpScript(path=concat, data=panel_29, fileName=panel_25, zoneNames=air_stl)  # -> out, A; inputs path: String, head: String, data: String, fileName: String, zoneNames: list of Mesh, actualBoundaries: list of GeometryBase, bMBoundaries: list of GeometryBase
# ---------- c_script: C# ----------
foreach (Mesh  m in zoneNames)
      {
           String directoryPath = path + @"\" + @"\constant\"   + m.UserDictionary["name"] + @"\";


    if (!Directory.Exists(directoryPath))
    {
      Directory.CreateDirectory(directoryPath);
    }

    String filePath =  directoryPath  + fileName;


   // A = filePath;


    File.Delete(filePath);


    using(var tw = new StreamWriter(filePath)) // new StreamWriter(path, true) for append
    {
      tw.WriteLine(head);
      tw.WriteLine(data );
      tw.Close();


  }

  A = data;


    }
# ---------- end c_script ----------
# Write out  system\blockMeshDict
panel_45 = Panel("blockMeshDict")
# Write out  constant\{zone}\thermophysicalProperties
# Write out  constant\regionProperties
panel_46 = Panel("thermophysicalProperties")
geom_stl_2 = Data(attachtouserdictionary_12)
c_script_2 = CSharpScript(path=concat, data=panel_27, fileName=panel_24, zoneNames=air_stl, bMBoundaries=allgeo)  # -> out, A; inputs path: String, head: String, data: String, fileName: String, zoneNames: list of Mesh, actualBoundaries: list of GeometryBase, bMBoundaries: list of GeometryBase
# ---------- c_script_2: C# ----------
 

  

foreach (Mesh  m in zoneNames)
      {
           String directoryPath = path + @"\" + @"\system\"   + m.UserDictionary["name"] + @"\";


    if (!Directory.Exists(directoryPath))
    {
      Directory.CreateDirectory(directoryPath);
    }

    String filePath =  directoryPath  + fileName;


    A = filePath;


    File.Delete(filePath);


    using(var tw = new StreamWriter(filePath)) // new StreamWriter(path, true) for append
    {
      tw.WriteLine(head);
      tw.WriteLine(data);

      tw.Close();


  }



    }



 foreach (Mesh  m in bMBoundaries)
      {
           String directoryPath = path + @"\" + @"\system\"   + m.UserDictionary["name"] + @"\";


    if (!Directory.Exists(directoryPath))
    {
      Directory.CreateDirectory(directoryPath);
    }

    String filePath =  directoryPath  + fileName;


    A = filePath;


    File.Delete(filePath);


    using(var tw = new StreamWriter(filePath)) // new StreamWriter(path, true) for append
    {
      tw.WriteLine(head);
      tw.WriteLine(data);

      tw.Close();


  }


    }
# ---------- end c_script_2 ----------
# Write out  system/{zone}/fvSolution Fluid
air_stl_3 = Geometry(attachtouserdictionary_11)
# Write out  constant\g
panel_47 = Panel("g")
c_script_3 = CSharpScript(path=concat, data=panel_28, fileName=panel_24, zoneNames=geom_stl, bMBoundaries=allgeo)  # -> out, A; inputs path: String, head: String, data: String, fileName: String, zoneNames: list of Mesh, actualBoundaries: list of GeometryBase, bMBoundaries: list of GeometryBase; same code as c_script_2
# Write out  system\probingLine3
panel_48 = Panel("probingLine3")
panel_49 = Panel("""/*--------------------------------*- C++ -*----------------------------------*\
  | =========                 |                                                 |
  | \\      /  F ield         | OpenFOAM: The Open Source CFD Toolbox           |
  |  \\    /   O peration     | Version:  5                                     |
  |   \\  /    A nd           | Web:      www.OpenFOAM.org                      |
  |    \\/     M anipulation  |                                                 |
  \*---------------------------------------------------------------------------*/

probingLine2
{{
                type probes;
                libs ("libsampling.so");
                writeControl writeTime;

                interpolationScheme cellPointFace;
                //interpolationScheme cellPoint;

                setFormat csv;

                fields (T);

                

                probeLocations
                  (



{0}


);
}}

            // ************************************************************************* //""")
geom_stl_3 = Data(attachtouserdictionary_12)
# Write out  system/fvSolution Solid
air_stl_4 = Geometry(attachtouserdictionary_11)
# Write out  system\controlDict
panel_50 = Panel("controlDict")
# Write out  constant\radiationProperties
panel_51 = Panel("radiationProperties")
panel_52 = Panel("""/*--------------------------------*- C++ -*----------------------------------*\
  | =========                 |                                                 |
  | \\      /  F ield         | OpenFOAM: The Open Source CFD Toolbox           |
  |  \\    /   O peration     | Version:  5                                     |
  |   \\  /    A nd           | Web:      www.OpenFOAM.org                      |
  |    \\/     M anipulation  |                                                 |
  \*---------------------------------------------------------------------------*/

probingLine3
{{
                type probes;
                libs ("libsampling.so");
                writeControl writeTime;

                interpolationScheme cellPointFace;
                //interpolationScheme cellPoint;

                setFormat csv;

                fields (T);

                

                probeLocations
                  (



{0}


);
}}

            // ************************************************************************* //""")
c_script_4 = CSharpScript(path=concat, head=panel_20, fileName="p_rgh")  # -> out, A; inputs path: String, head: String, data: String, fileName: String, boundaryPatches: list of GeometryBase, emptyPatches: list of GeometryBase, remainingPatches: list of String
# ---------- c_script_4: C# ----------
      String directoryPath = path + @"\0\" ;

      if (!Directory.Exists(directoryPath))
      {
        Directory.CreateDirectory(directoryPath);
      }


      String filePath = directoryPath + @"\" + fileName;


      A = filePath;



      File.Delete(filePath);

      using(var tw = new StreamWriter(filePath)) // new StreamWriter(path, true) for append
      {
        tw.WriteLine(head);
        tw.WriteLine(data);

        tw.WriteLine("dimensions [1 -1 -2 0 0 0 0];");

        tw.WriteLine("internalField uniform 1e5;");




        /*foreach (GeometryBase emptyPatch in emptyPatches)
        {

          tw.WriteLine(emptyPatch.UserDictionary["name"]);
          tw.WriteLine("{");
          tw.WriteLine("type calculated;");
          tw.WriteLine("value $internalField;");
          tw.WriteLine("}");

        }
        foreach (String str in remainingPatches)
        {

          tw.WriteLine(str);
          tw.WriteLine("{");
          tw.WriteLine("type calculated;");
          tw.WriteLine("value $internalField;");
          tw.WriteLine("}");

        }

        tw.WriteLine("}");*/

        tw.WriteLine("boundaryField");
        tw.WriteLine("{");
        tw.WriteLine("\".*\"");
        tw.WriteLine("{");
        tw.WriteLine("type calculated;");
        tw.WriteLine("value $internalField;");
        tw.WriteLine("}");
        tw.WriteLine("}");


        tw.Close();








    }
# ---------- end c_script_4 ----------
c_script_5 = CSharpScript(
    path=concat,
    head=panel_20,
    fileName="p_rgh",
    zoneNames=getname_21.Name,
    boundaryPatches=boundarypatches,
    remainingPatches=allgeo)  # -> out, A; inputs path: String, head: String, data: String, fileName: String, zoneNames: list of String, boundaryPatches: list of GeometryBase, emptyPatches: list of GeometryBase, remainingPatches: list of GeometryBase
# ---------- c_script_5: C# ----------
    foreach (String zoneName in zoneNames){



      String directoryPath = path + @"\0\" + zoneName;

      if (!Directory.Exists(directoryPath))
      {
        Directory.CreateDirectory(directoryPath);
      }


      String filePath = directoryPath + @"\" + fileName;


      A = filePath;



      File.Delete(filePath);

      using(var tw = new StreamWriter(filePath)) // new StreamWriter(path, true) for append
      {
        tw.WriteLine(head);
        tw.WriteLine(data);

        tw.WriteLine("dimensions [1 -1 -2 0 0 0 0];");

        tw.WriteLine("internalField uniform 100000;");

        tw.WriteLine("boundaryField");
        tw.WriteLine("{");




        foreach (GeometryBase patch in boundaryPatches)
        {

          tw.WriteLine(patch.UserDictionary["name"]);
          tw.WriteLine("{");
          tw.WriteLine("\t type fixedFluxPressure;");
          tw.WriteLine("\t value uniform 100000;");
          tw.WriteLine("}");

        }
        foreach (GeometryBase patch in remainingPatches)
        {

          tw.WriteLine(patch.UserDictionary["name"]);
          tw.WriteLine("{");
          tw.WriteLine("\t type fixedFluxPressure;");
          tw.WriteLine("\t value uniform 100000;");
          tw.WriteLine("}");

        }



        //tw.WriteLine("}");


        tw.WriteLine("\".*\"");
        tw.WriteLine("{");
        tw.WriteLine("\t type fixedFluxPressure;");
        tw.WriteLine("\t value uniform 100000;");
        tw.WriteLine("}");
        tw.WriteLine("}");


        tw.Close();


      }





    }
# ---------- end c_script_5 ----------
panel_53 = Panel("""/*--------------------------------*- C++ -*----------------------------------*\
| =========                 |                                                 |
| \\      /  F ield         | OpenFOAM: The Open Source CFD Toolbox           |
|  \\    /   O peration     | Version:  v2306                                 |
|   \\  /    A nd           | Website:  www.openfoam.com                      |
|    \\/     M anipulation  |                                                 |
\*---------------------------------------------------------------------------*/
FoamFile
{{
    version     2.0;
    format      ascii;
    class       dictionary;
    object      blockMeshDict;
}}
// * * * * * * * * * * * * * * * * * * * * * * * * * * * * * * * * * * * * * //

scale   1;

vertices
(

{0}



);
blocks
(
        hex (0 1 2 3 4 5 6 7) (20 20 20) simpleGrading (1 1 1)
);

edges
(
);

boundary
(
    maxY
    {{
        type wall;
        faces
        (
            (3 7 6 2)
        );
    }}
    minX
    {{
        type patch;
        faces
        (
            (0 4 7 3)
        );
    }}
    maxX
    {{
        type patch;
        faces
        (
            (2 6 5 1)
        );
    }}
    minY
    {{
        type wall;
        faces
        (
            (1 5 4 0)
        );
    }}
    minZ
    {{
        type wall;
        faces
        (
            (0 3 2 1)
        );
    }}
    maxZ
    {{
        type wall;
        faces
        (
            (4 5 6 7)
        );
    }}
);

mergePatchPairs
(
);


// ************************************************************************* //""")
c_script_6 = CSharpScript(path=concat, head=panel_21, fileName="U")  # -> out, A; inputs path: String, head: String, data: String, fileName: String, boundaryPatches: list of GeometryBase, emptyPatches: list of GeometryBase, remainingPatches: list of String
# ---------- c_script_6: C# ----------
      String directoryPath = path + @"\0\" ;

      if (!Directory.Exists(directoryPath))
      {
        Directory.CreateDirectory(directoryPath);
      }


      String filePath = directoryPath + @"\" + fileName;


      A = filePath;



      File.Delete(filePath);

      using(var tw = new StreamWriter(filePath)) // new StreamWriter(path, true) for append
      {
        tw.WriteLine(head);
        tw.WriteLine(data);

        tw.WriteLine("dimensions [0 1 -1 0 0 0 0];");

        tw.WriteLine("internalField uniform (0 0 0.01);");




        /*foreach (GeometryBase emptyPatch in emptyPatches)
        {

          tw.WriteLine(emptyPatch.UserDictionary["name"]);
          tw.WriteLine("{");
          tw.WriteLine("type fixedValue;");
          tw.WriteLine("value $internalField;");
          tw.WriteLine("}");

        }
        foreach (String str in remainingPatches)
        {

          tw.WriteLine(str);
          tw.WriteLine("{");
          tw.WriteLine("type fixedValue;");
          tw.WriteLine("value $internalField;");
          tw.WriteLine("}");

        }

        tw.WriteLine("}");*/

        tw.WriteLine("boundaryField");
    	  tw.WriteLine("{");
        tw.WriteLine(@"#includeEtc ""caseDicts/setConstraintTypes""");


        tw.WriteLine("\".*\"");
        tw.WriteLine("{");
        tw.WriteLine("type fixedValue;");
        tw.WriteLine("value $internalField;");
        tw.WriteLine("}");
        tw.WriteLine("}");


        tw.Close();








    }
# ---------- end c_script_6 ----------
c_script_7 = CSharpScript(
    path=concat,
    head=panel_21,
    fileName="U",
    zoneNames=getname_21.Name,
    boundaryPatches=boundarypatches_2,
    remainingPatches=allgeo)  # -> out, A; inputs path: String, head: String, data: String, fileName: String, zoneNames: list of String, boundaryPatches: list of GeometryBase, emptyPatches: list of GeometryBase, remainingPatches: list of GeometryBase
# ---------- c_script_7: C# ----------
    foreach (String zoneName in zoneNames){



      String directoryPath = path + @"\0\" + zoneName;

      if (!Directory.Exists(directoryPath))
      {
        Directory.CreateDirectory(directoryPath);
      }


      String filePath = directoryPath + @"\" + fileName;


      A = filePath;



      File.Delete(filePath);

      using(var tw = new StreamWriter(filePath)) // new StreamWriter(path, true) for append
      {
        tw.WriteLine(head);
        tw.WriteLine(data);

        tw.WriteLine("dimensions [0 1 -1 0 0 0 0];");

        tw.WriteLine("internalField uniform (0 0 0.01);");

        tw.WriteLine("boundaryField");
        tw.WriteLine("{");




        foreach (GeometryBase patch in boundaryPatches)
        {

          tw.WriteLine(patch.UserDictionary["name"]);
          tw.WriteLine("{");
          tw.WriteLine("\t type fixedValue;");
          tw.WriteLine("\t value uniform ( 0 0 0 );;");
          tw.WriteLine("}");

        }
        foreach (GeometryBase patch in remainingPatches)
        {

          tw.WriteLine(patch.UserDictionary["name"]);
          tw.WriteLine("{");
          tw.WriteLine("\t type fixedValue;");
          tw.WriteLine("\t value uniform ( 0 0 0 );");
          tw.WriteLine("}");

        }



        //tw.WriteLine("}");


        tw.WriteLine("\".*\"");
        tw.WriteLine("{");
        tw.WriteLine("\t type fixedValue;");
        tw.WriteLine("\t value uniform ( 0 0 0 );");
        tw.WriteLine("}");
        tw.WriteLine("}");


        tw.Close();


      }





    }
# ---------- end c_script_7 ----------
c_script_8 = CSharpScript(path=concat, data=panel_19, fileName="fvSolution", zoneNames=geom_stl_3, bMBoundaries=allgeo)  # -> out, A; inputs path: String, head: String, data: String, fileName: String, zoneNames: list of Mesh, actualBoundaries: list of GeometryBase, bMBoundaries: list of GeometryBase
# ---------- c_script_8: C# ----------
foreach (Mesh  m in zoneNames)
      {
           String directoryPath = path + @"\" + @"\system\"   + m.UserDictionary["name"] + @"\";


    if (!Directory.Exists(directoryPath))
    {
      Directory.CreateDirectory(directoryPath);
    }

    String filePath =  directoryPath  + fileName;


    A = filePath;


    File.Delete(filePath);


    using(var tw = new StreamWriter(filePath)) // new StreamWriter(path, true) for append
    {
      tw.WriteLine(head);
      tw.WriteLine(data);

      tw.Close();


  }



    }



 foreach (Mesh  m in bMBoundaries)
      {
           String directoryPath = path + @"\" + @"\system\"   + m.UserDictionary["name"] + @"\";


    if (!Directory.Exists(directoryPath))
    {
      Directory.CreateDirectory(directoryPath);
    }

    String filePath =  directoryPath  + fileName;


    A = filePath;


    File.Delete(filePath);


    using(var tw = new StreamWriter(filePath)) // new StreamWriter(path, true) for append
    {
      tw.WriteLine(head);
      tw.WriteLine(data);

      tw.Close();


  }


    }
# ---------- end c_script_8 ----------
c_script_9 = CSharpScript(path=concat, head=panel_22, fileName="p")  # -> out, A; inputs path: String, head: String, data: String, fileName: String, boundaryPatches: list of GeometryBase, emptyPatches: list of GeometryBase, remainingPatches: list of String
# ---------- c_script_9: C# ----------
      String directoryPath = path + @"\0\" ;

      if (!Directory.Exists(directoryPath))
      {
        Directory.CreateDirectory(directoryPath);
      }


      String filePath = directoryPath + @"\" + fileName;


      A = filePath;



      File.Delete(filePath);

      using(var tw = new StreamWriter(filePath)) // new StreamWriter(path, true) for append
      {
        tw.WriteLine(head);
        tw.WriteLine(data);

        tw.WriteLine("dimensions [1 -1 -2 0 0 0 0];");

        tw.WriteLine("internalField uniform 100000;");




        /*foreach (GeometryBase emptyPatch in emptyPatches)
        {

          tw.WriteLine(emptyPatch.UserDictionary["name"]);
          tw.WriteLine("{");
          tw.WriteLine("type calculated;");
          tw.WriteLine("value $internalField;");
          tw.WriteLine("}");

        }
        foreach (String str in remainingPatches)
        {

          tw.WriteLine(str);
          tw.WriteLine("{");
          tw.WriteLine("type calculated;");
          tw.WriteLine("value $internalField;");
          tw.WriteLine("}");

        }

        tw.WriteLine("}");*/

        tw.WriteLine("boundaryField");
        tw.WriteLine("{");
        tw.WriteLine("\".*\"");
        tw.WriteLine("{");
        tw.WriteLine("type calculated;");
        tw.WriteLine("value $internalField;");
        tw.WriteLine("}");
        tw.WriteLine("}");


        tw.Close();


     





    }
# ---------- end c_script_9 ----------
c_script_10 = CSharpScript(
    path=concat,
    head=panel_22,
    fileName="p",
    zoneNames=getname_21.Name,
    boundaryPatches=boundarypatches_3,
    remainingPatches=allgeo)  # -> out, A; inputs path: String, head: String, data: String, fileName: String, zoneNames: list of String, boundaryPatches: list of GeometryBase, emptyPatches: list of GeometryBase, remainingPatches: list of GeometryBase
# ---------- c_script_10: C# ----------
    foreach (String zoneName in zoneNames){



      String directoryPath = path + @"\0\" + zoneName;

      if (!Directory.Exists(directoryPath))
      {
        Directory.CreateDirectory(directoryPath);
      }


      String filePath = directoryPath + @"\" + fileName;


      A = filePath;



      File.Delete(filePath);

      using(var tw = new StreamWriter(filePath)) // new StreamWriter(path, true) for append
      {
        tw.WriteLine(head);
        tw.WriteLine(data);

        tw.WriteLine("dimensions [1 -1 -2 0 0 0 0];");

        tw.WriteLine("internalField uniform 100000;");

        tw.WriteLine("boundaryField");
        tw.WriteLine("{");




        foreach (GeometryBase patch in boundaryPatches)
        {

          tw.WriteLine(patch.UserDictionary["name"]);
          tw.WriteLine("{");
          tw.WriteLine("\t type calculated;");
          tw.WriteLine("\t value uniform 100000;");
          tw.WriteLine("}");

        }
        foreach (GeometryBase patch in remainingPatches)
        {

          tw.WriteLine(patch.UserDictionary["name"]);
          tw.WriteLine("{");
          tw.WriteLine("\t type calculated;");
          tw.WriteLine("\t value $internalField;");
          tw.WriteLine("}");

        }



        //tw.WriteLine("}");


        tw.WriteLine("\".*\"");
        tw.WriteLine("{");
        tw.WriteLine("\t type calculated;");
        tw.WriteLine("\t value $internalField;");
        tw.WriteLine("}");
        tw.WriteLine("}");


        tw.Close();


      }





    }
# ---------- end c_script_10 ----------
c_script_11 = CSharpScript(path=concat, head=panel_31, fileName="T", zoneNames=[geom_stl_2, air_stl_3], bMBoundaries=boundarypatches_3)  # -> out, A; inputs path: String, head: String, data: String, fileName: String, zoneNames: list of Mesh, actualBoundaries: list of GeometryBase, bMBoundaries: list of GeometryBase; disabled
# ---------- c_script_11: C# ----------
    String directoryPath = path + @"\0\";

    if (!Directory.Exists(directoryPath))
    {
      Directory.CreateDirectory(directoryPath);
    }


    String filePath = directoryPath + @"\" + fileName;


    A = filePath;



    File.Delete(filePath);

    using(var tw = new StreamWriter(filePath)) // new StreamWriter(path, true) for append
    {
      tw.WriteLine(head);
      tw.WriteLine(data);




      tw.WriteLine("boundaryField");
      tw.WriteLine("{");
      foreach (Mesh  m in zoneNames)
      {
        //tw.WriteLine(str);
        //tw.WriteLine("{");
        tw.WriteLine(m.UserDictionary["name"]);
        tw.WriteLine("{");
        tw.WriteLine("  type " + m.UserDictionary["type"] + ";");
        tw.WriteLine("  value uniform " + m.UserDictionary["temp"] + ";");
        tw.WriteLine("}");
        //tw.WriteLine("}");
      }
      foreach (GeometryBase geo in bMBoundaries)
      {
        tw.WriteLine(geo.UserDictionary["name"]);
        tw.WriteLine("{");
        tw.WriteLine("  type " + geo.UserDictionary["type"] + ";");
        tw.WriteLine("  value uniform " + geo.UserDictionary["temp"] + ";");
        tw.WriteLine("}");
      }

      foreach (GeometryBase geo in actualBoundaries)
      {
        tw.WriteLine(geo.UserDictionary["name"]);
        tw.WriteLine("{");
        tw.WriteLine("  type " + geo.UserDictionary["type"] + ";");
        tw.WriteLine("  value uniform " + geo.UserDictionary["temp"] + ";");
        tw.WriteLine("}");
        tw.WriteLine(geo.UserDictionary["name"].ToString().Split(new string[] { "_to_" }, StringSplitOptions.None)[1] + "_to_" + geo.UserDictionary["name"].ToString().Split(new string[] { "_to_" }, StringSplitOptions.None)[0]);
        tw.WriteLine("{");
        tw.WriteLine("  type " + geo.UserDictionary["type"] + ";");
        tw.WriteLine("  value uniform " + geo.UserDictionary["temp"] + ";");
        tw.WriteLine("}");
      }

      tw.WriteLine("}");



      tw.Close();








    }
# ---------- end c_script_11 ----------
c_script_12 = CSharpScript(path=concat, data=panel_19, fileName="fvSolution", zoneNames=air_stl_4, bMBoundaries=allgeo)  # -> out, A; inputs path: String, head: String, data: String, fileName: String, zoneNames: list of Mesh, actualBoundaries: list of GeometryBase, bMBoundaries: list of GeometryBase; same code as c_script_8
c_script_13 = CSharpScript(path=concat, data=panel_32, fileName=panel_33)  # -> out, A; inputs path: String, head: String, data: String, fileName: String, vertices: String
# ---------- c_script_13: C# ----------
           String directoryPath = path + @"\" + @"\system\"   ;


    if (!Directory.Exists(directoryPath))
    {
      Directory.CreateDirectory(directoryPath);
    }

    String filePath =  directoryPath  + fileName;


   // A = filePath;


    File.Delete(filePath);


    using(var tw = new StreamWriter(filePath)) // new StreamWriter(path, true) for append
    {
      tw.WriteLine(head);
      tw.WriteLine( data       );
      tw.Close();


  }

  A = data;
# ---------- end c_script_13 ----------
c_script_14 = CSharpScript(path=concat, data=panel_44, fileName=panel_38, vertices=text_join_3)  # -> out, A; inputs path: String, head: String, data: String, fileName: String, vertices: String
# ---------- c_script_14: C# ----------
           String directoryPath = path + @"\" + @"\system\"   ;


    if (!Directory.Exists(directoryPath))
    {
      Directory.CreateDirectory(directoryPath);
    }

    String filePath =  directoryPath  + fileName;


   // A = filePath;


    File.Delete(filePath);


    using(var tw = new StreamWriter(filePath)) // new StreamWriter(path, true) for append
    {
      tw.WriteLine(head);
      tw.WriteLine(String.Format( data  , vertices))     ;
      tw.Close();


  }

  A = data;
# ---------- end c_script_14 ----------
c_script_15 = CSharpScript(path=concat, data=panel_35, fileName=panel_39)  # -> out, A; inputs path: String, head: String, data: String, fileName: String, vertices: String; same code as c_script_13
c_script_16 = CSharpScript(path=concat, data=panel_37, fileName=panel_41, vertices=join_2)  # -> out, A; inputs path: String, head: String, data: String, fileName: String, vertices: String
# ---------- c_script_16: C# ----------
           String directoryPath = path + @"\" + @"\system\"   ;


    if (!Directory.Exists(directoryPath))
    {
      Directory.CreateDirectory(directoryPath);
    }

    String filePath =  directoryPath  + fileName;


   // A = filePath;


    File.Delete(filePath);


    using(var tw = new StreamWriter(filePath)) // new StreamWriter(path, true) for append
    {
      tw.WriteLine(head);
      tw.WriteLine(String.Format(   data, vertices      )     );
      tw.Close();


  }

  A = data;
# ---------- end c_script_16 ----------
c_script_17 = CSharpScript(path=concat, data=panel_49, fileName=panel_42, vertices=text_join)  # -> out, A; inputs path: String, head: String, data: String, fileName: String, vertices: String; same code as c_script_14
c_script_18 = CSharpScript(path=concat, data=panel_34, fileName=panel_47)  # -> out, A; inputs path: String, head: String, data: String, fileName: String, zoneNames: list of Mesh, actualBoundaries: list of GeometryBase, bMBoundaries: list of GeometryBase
# ---------- c_script_18: C# ----------
           String directoryPath = path + @"\" + @"\constant\"   ;


    if (!Directory.Exists(directoryPath))
    {
      Directory.CreateDirectory(directoryPath);
    }

    String filePath =  directoryPath  + fileName;


   // A = filePath;


    File.Delete(filePath);


    using(var tw = new StreamWriter(filePath)) // new StreamWriter(path, true) for append
    {
      tw.WriteLine(head);
      tw.WriteLine( data );
      tw.Close();


  }

  A = data;
# ---------- end c_script_18 ----------
c_script_19 = CSharpScript(
    path=concat,
    fileName=panel_46,
    zoneNames=[attachtouserdictionary_10, attachtouserdictionary_5, attachtouserdictionary_9, attachtouserdictionary_8, attachtouserdictionary_7, attachtouserdictionary_3, attachtouserdictionary_6, attachtouserdictionary_4, attachtouserdictionary_2, attachtouserdictionary])  # -> out, A; inputs path: String, head: String, data: String, fileName: String, zoneNames: list of Mesh, actualBoundaries: list of GeometryBase, bMBoundaries: list of GeometryBase
# ---------- c_script_19: C# ----------
string formatSTring = @"/*--------------------------------*- C++ -*----------------------------------*\
| =========                 |                                                 |
| \\      /  F ield         | OpenFOAM: The Open Source CFD Toolbox           |
|  \\    /   O peration     | Version:  v2306                                 |
|   \\  /    A nd           | Website:  www.openfoam.com                      |
|    \\/     M anipulation  |                                                 |
\*---------------------------------------------------------------------------*/
FoamFile
{{
    version     2.0;
    format      ascii;
    class       dictionary;
    object      thermophysicalProperties;
}}
// * * * * * * * * * * * * * * * * * * * * * * * * * * * * * * * * * * * * * //

thermoType
{{
    type            {0}
    mixture         pureMixture;
    transport       {1}
    thermo          hConst;
    equationOfState {2}
    specie          specie;
    energy          sensibleEnthalpy;
  }}

mixture
{{
    {3}
}}


// ************************************************************************* //
";









foreach (Mesh  m in zoneNames)
      {
           String directoryPath = path + @"\" + @"\constant\"   + m.UserDictionary["name"] + @"\";


    if (!Directory.Exists(directoryPath))
    {
      Directory.CreateDirectory(directoryPath);
    }

    String filePath =  directoryPath  + fileName;


   // A = filePath;


    File.Delete(filePath);


    using(var tw = new StreamWriter(filePath)) // new StreamWriter(path, true) for append
    {
      tw.WriteLine(head);
      tw.WriteLine(String.Format(formatSTring, m.UserDictionary["typeThermoProp"] +";", m.UserDictionary["transportThermoProp"] +";", m.UserDictionary["eqOfStateThermoProp"]+";" , m.UserDictionary["mixture"] ) );
      tw.Close();


  }

  A = data;


    }



 foreach (Mesh  m in bMBoundaries)
      {
           String directoryPath = path + @"\" + @"\constant\"   + m.UserDictionary["name"] + @"\";


    if (!Directory.Exists(directoryPath))
    {
      Directory.CreateDirectory(directoryPath);
    }

    String filePath =  directoryPath  + fileName;


   // A = filePath;


    File.Delete(filePath);


    using(var tw = new StreamWriter(filePath)) // new StreamWriter(path, true) for append
    {
    tw.WriteLine(head);
      tw.WriteLine(String.Format(formatSTring, m.UserDictionary["typeThermoProp"] +";", m.UserDictionary["transportThermoProp"] +";", m.UserDictionary["eqOfStateThermoProp"] +";", m.UserDictionary["mixture"] +";")  );
      tw.Close();


  }


    }
# ---------- end c_script_19 ----------
c_script_20 = CSharpScript(path=concat, data=panel_53, fileName=panel_45, vertices=join)  # -> out, A; inputs path: String, head: String, data: String, fileName: String, vertices: String; same code as c_script_16
c_script_21 = CSharpScript(path=concat, data=panel_40, fileName="regionProperties")  # -> out, A; inputs path: String, head: String, data: String, fileName: String, zoneNames: list of Mesh, actualBoundaries: list of GeometryBase, bMBoundaries: list of GeometryBase; same code as c_script_18
c_script_22 = CSharpScript(path=concat, data=panel_43, fileName=panel_51)  # -> out, A; inputs path: String, head: String, data: String, fileName: String, zoneNames: list of Mesh, actualBoundaries: list of GeometryBase, bMBoundaries: list of GeometryBase; same code as c_script_18
c_script_23 = CSharpScript(path=concat, data=panel_52, fileName=panel_48, vertices=text_join_2)  # -> out, A; inputs path: String, head: String, data: String, fileName: String, vertices: String; same code as c_script_14
c_script_24 = CSharpScript(path=concat, data=panel_36, fileName=panel_50)  # -> out, A; inputs path: String, head: String, data: String, fileName: String, zoneNames: list of Mesh, actualBoundaries: list of GeometryBase, bMBoundaries: list of GeometryBase
# ---------- c_script_24: C# ----------
           String directoryPath = path + @"\" + @"\system\"   ;


    if (!Directory.Exists(directoryPath))
    {
      Directory.CreateDirectory(directoryPath);
    }

    String filePath =  directoryPath  + fileName;


   // A = filePath;


    File.Delete(filePath);


    using(var tw = new StreamWriter(filePath)) // new StreamWriter(path, true) for append
    {
      tw.WriteLine(head);
      tw.WriteLine( data );
      tw.Close();


  }

  A = data;
# ---------- end c_script_24 ----------
geometry_4 = Geometry(<brep referenced from the Rhino model>)  # disabled
panel_54 = Panel("8")  # disabled
deconstruct_brep = DeconstructBrep(Brep=geometry_4)  # -> Faces, Edges, Vertices; disabled
series = Series(Start=0, Step=1, Count=panel_54)  # disabled
panel_55 = Panel(deconstruct_brep.Vertices)  # disabled
number_slider = Slider(0, range=0..10)  # disabled
panel_56 = Panel("1")  # disabled
# Surf Combinations
panel_57 = Panel("Brick")  # disabled
panel_58 = Panel("Insulationtop")  # disabled
panel_59 = Panel("Insulationbot")  # disabled
panel_60 = Panel("conretetop")  # disabled
panel_61 = Panel("oncretebot")  # disabled
panel_62 = Panel("slab")  # disabled
panel_63 = Panel("Plaster")  # disabled
panel_64 = Panel("ExtAir")  # disabled
panel_65 = Panel("Intairtop")  # disabled
panel_66 = Panel("Intairbot")  # disabled
shift_list = ShiftList(List=series, Shift=number_slider, Wrap=True)  # disabled
text_tag_3d_2 = TextTag3D(Location=deconstruct_brep.Vertices, Text=shift_list, Size=panel_56, Justification=7)  # disabled

entwine_2 = Entwine(
    Branch00=panel_57,
    Branch01=panel_58,
    Branch02=panel_59,
    Branch03=panel_60,
    Branch04=panel_61,
    Branch05=panel_62,
    Branch06=panel_63,
    Branch07=panel_64,
    Branch08=panel_65,
    Branch09=panel_66,
    FlattenInputs=True)  # -> flatten(Result); disabled
cross_reference_2 = CrossReference(ListListA=entwine_2, ListListB=entwine_2, CrossMode=1)  # -> ListListA, ListListB; disabled
panel_67 = Panel("_to_")  # disabled
concatenate_2 = Concatenate(Fragment_A=cross_reference_2.ListListA, Fragment_B=panel_67, A=cross_reference_2.ListListB)  # disabled
panel_68 = Panel(concatenate_2)  # disabled

# ----
# Points Locations
area = Area()  # -> Area, Centroid; disabled
area_2 = Area()  # -> Area, Centroid; disabled
entwine_3 = Entwine(Branch00=area.Centroid, Branch01=area_2.Centroid, FlattenInputs=True)  # -> flatten(Result); disabled
ghpython_script = GhPythonScript(zones=entwine_2, centerPoints=entwine_3)  # -> out, LIM; inputs zones: list, centerPoints: list of Point3d; disabled
# ---------- ghpython_script: Python ----------
__author__ = "mimit"
__version__ = "2023.11.20"

import rhinoscriptsyntax as rs

res = """locationsInMesh
(\n"""


for i, zone in enumerate(zones):
    res = res + "    ((" +   str(centerPoints[i].X) +  " " +   str(centerPoints[i].Y) +  " "+   str(centerPoints[i].Z) +    ") " + str(zone) + ")\n"


res = res + (""");""")

LIM = res
# ---------- end ghpython_script ----------
panel_69 = Panel(ghpython_script.LIM)  # disabled

ghpython_script_2 = GhPythonScript(x=panel_55)  # -> out, a; inputs x: list; disabled
# ---------- ghpython_script_2: Python ----------
__author__ = "mimit"
__version__ = "2024.02.22"

import rhinoscriptsyntax as rs

templist = x
newlist = []

newlist.append(templist[3])
newlist.append( templist[7])
newlist.append( templist[5])
newlist.append( templist[2])

newlist.append( templist[0])
newlist.append( templist[6])
newlist.append( templist[4])
newlist.append( templist[1])

a = newlist
# ---------- end ghpython_script_2 ----------
panel_70 = Panel(shift_list)  # disabled
panel_71 = Panel(ghpython_script_2.a)  # disabled
ghpython_script_3 = GhPythonScript(x=panel_71)  # -> out, a; disabled
# ---------- ghpython_script_3: Python ----------
__author__ = "mimit"
__version__ = "2024.02.22"

import rhinoscriptsyntax as rs



a = x.replace("{", "(").replace(",", "").replace("}", ")")
# ---------- end ghpython_script_3 ----------
panel_72 = Panel(ghpython_script_3.a)  # disabled
concatenate_3 = Concatenate(Fragment_A=getname_23.Name, Fragment_B="_to_", A=getname_22.Name)

panel_73 = Panel(concatenate_3)

# ----
# Write out  0/T
crossref = Data(panel_73)
c_script_25 = CSharpScript(
    path=concat,
    head=panel_18,
    fileName=panel_30,
    zoneNames=allgeo,
    STL=[geom_stl_2, air_stl_3],
    crossRefZoneNames=concatenate_3,
    bMBoundaries=boundarypatches_3)  # -> out, A; inputs path: String, head: String, data: String, fileName: String, zoneNames: list of Mesh, STL: list of Mesh, crossRefZoneNames: list of String, actualBoundaries: list of String, bMBoundaries: list of GeometryBase; disabled
# ---------- c_script_25: C# ----------
    foreach (Mesh zN in zoneNames)
    {
      String directoryPath = path + @"\0\" +    zN.UserDictionary["name"];

      if (!Directory.Exists(directoryPath))
      {
        Directory.CreateDirectory(directoryPath);
      }

      String filePath = directoryPath + @"\" + fileName;

      A = filePath;

      File.Delete(filePath);

      using (var tw = new StreamWriter(filePath)) // new StreamWriter(path, true) for append
      {
        tw.WriteLine(head);
        tw.WriteLine(data);

        tw.WriteLine("boundaryField");
        tw.WriteLine("{");


        foreach (String str in crossRefZoneNames)
        {
          tw.WriteLine(str);
          tw.WriteLine("{");

        if ((string)zN.UserDictionary["typeThermoProp"] == "heSolidThermo"){

          tw.WriteLine(
            @"            type          compressible::turbulentTemperatureRadCoupledMixed;
            value  uniform 275;
            Tnbr T;
            K solidThermo;
            kappaMethod solidThermo;
            "
            );
        }
        else{

 tw.WriteLine(
            @"            type          compressible::turbulentTemperatureRadCoupledMixed;
            value  uniform 285;
            Tnbr T;
            K fluidThermo;
            kappaMethod fluidThermo;
            "
            );



        }



          tw.WriteLine("}");
        }




        foreach (String s in actualBoundaries)
        {
          tw.WriteLine(s);
          tw.WriteLine("{");
          tw.WriteLine("type fixedValue;");
          tw.WriteLine("value uniform 273;");
          tw.WriteLine("}");
          tw.WriteLine(
            s.ToString().Split(new string[] { "_to_" }, StringSplitOptions.None)[1]
            + "_to_"
            + s.ToString().Split(new string[] { "_to_" }, StringSplitOptions.None)[0]
            );

          tw.WriteLine("{");
          tw.WriteLine("type fixedValue;");
          tw.WriteLine("value uniform 273;");
          tw.WriteLine("}");
        }


        foreach (Mesh  m in STL)
      {
        //tw.WriteLine(str);
        //tw.WriteLine("{");
        tw.WriteLine(m.UserDictionary["name"]);
        tw.WriteLine("{");
        tw.WriteLine("      type " + m.UserDictionary["type"] + ";");
        tw.WriteLine("      value uniform " + m.UserDictionary["temp"] + ";");
        tw.WriteLine("}");
        //tw.WriteLine("}");
      }



        foreach (GeometryBase geo in bMBoundaries)
        {
          tw.WriteLine(geo.UserDictionary["name"]);
          tw.WriteLine("{");
          if (geo.UserDictionary.ContainsKey("type"))
          {
            tw.WriteLine("            type " + geo.UserDictionary["type"] + ";");
          }
          else
          {
            tw.WriteLine("            // Key 'type' not found in dictionary");
          }
          tw.WriteLine("            value uniform " + geo.UserDictionary["temp"] + ";");
          tw.WriteLine("}");
        }

        tw.WriteLine("}");

        tw.Close();
      }
    }
# ---------- c_script_25: C# additional code ----------
  /// <summary>
  /// This method will be called once every solution, before any calls to RunScript.
  /// </summary>
  public override void BeforeRunScript()
  { }
  /// <summary>
  /// This method will be called once every solution, after any calls to RunScript.
  /// </summary>
  public override void AfterRunScript()
  { }
# ---------- end c_script_25 ----------

# ==== cluster MakeOFDict
text = ClusterInput()
replace_text = ReplaceText(Text=text, Find=",", RecursiveReplace=False)
replace_text_2 = ReplaceText(Text=replace_text, Find="{", Replace="(", RecursiveReplace=False)
panel = Panel(replace_text_2)
replace_text_3 = ReplaceText(Text=replace_text_2, Find="}", Replace=")", RecursiveReplace=False)
result = ClusterOutput(replace_text_3)

# ==== cluster BlockMesh
content = ClusterInput()
bounding_box = BoundingBox(Content=flatten(content), Plane=PlaneXY(0, 0, 0), UnionBox=True)  # -> Box, Box_2
area = Area(Geometry=bounding_box.Box)  # -> Area, Centroid
scale = Scale(Geometry=bounding_box.Box, Center=area.Centroid, Factor="1.00")  # -> Geometry, Transform
geometry = Geometry(scale.Geometry)
deconstruct_brep = DeconstructBrep(Brep=geometry)  # -> Faces, Edges, Vertices
panel = Panel(deconstruct_brep.Vertices)
panel_2 = ClusterOutput(panel)
series = Series(Start=0, Step=1, Count="8")
makeofdict = MakeOFDict(text=panel)
result = ClusterOutput(makeofdict)
series_2 = ClusterOutput(series)

# ==== cluster Cluster
C = ClusterInput()
bbox = BoundingBox(Content=C, Plane=PlaneXY(0, 0, 0), UnionBox=True)  # -> Box, Box_2
debrep = DeconstructBrep(Brep=bbox.Box)  # -> graft(Faces), Edges, Vertices
F = ClusterOutput(debrep.Faces)
